% Simulink data dictionary DD_State_Machine.sldd
% references OurShared_DD.sldd

Contact = enum(DefaultValue="Open", StorageType="int8")
  Init = 0
  Open = 1
  Close = 2

contactorTime = uint16(200)
timeoutContactor = uint8(1)
timeoutCurrent = uint8(1)

Fault_out = Simulink.Bus()
  Charger: boolean
  Inverter: boolean