% Simulink data dictionary OurShared_DD.sldd

Q = 5.134437
OCV_values = [3.020328 3.155503 3.232841 3.291323 3.338942 3.379688 3.415352 3.447536 3.47691 3.50385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 4.147089]
M = 0.0443417
M0 = 0.002542395
R = 0.002515136
R0 = 0.01116324
SigmaX0 = [0.001 0 0; 0 0.001 0; 0 0 0.01]
dOCV = [27.03513 21.25132 13.58202 10.61011 8.836422 7.64098 6.784823 6.15584 5.631444 5.174652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 2.084136]
delta_t = 0.1
eta = 0.9929435
sigmaV = 0.2
sigmaW = 10
soc_values = [0 0.005 0.01 0.015 0.02 0.025 0.03 0.035 0.04 0.045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 1]
taw = 2.410724

From_BMS = Simulink.Bus()
  SwitcingCommands: Bus: SwitcingCommands
  BalancigCommands: single[Ns,1]
  Reset: uint16

Ns = 7

BMS_input = Simulink.Bus()
  PackVoltage: double
  CellVoltages: uint16[Ns,1]
  PackCurrentDis: uint16
  PackCurrentChg: uint16
  Temperature: uint16[3 1]
  Fault: single
  FAULT_SUM: uint16

SwitcingCommands = Simulink.Bus()
  PosContactorInvCommand: boolean
  PreChargeRelayInvCommand: boolean
  NegContactorInvCommand: boolean
  PosContactorChrCommand: boolean
  PreChargeRelayChrCommand: boolean
  NegContactorChrCommand: boolean

SRE = enum(DefaultValue="Standby", StorageType="uint8")
  Standby = 0
  Charging = 1
  Driving = 2